# Grasshopper definition AS_01_Dome_Definition.gh (Grasshopper 1.0.7)
# plug-ins: Bifocals

# ----
# Circle
number_slider = Slider(8, range=0..10)
gene_pool = GenePool(Decimals=1, Maximum=2, Minimum=1, Value=[1, 1.1, 1.2])

shell_radius = GetInteger(Slider(12, range=0..20), AtLeast=1, AtMost=1, Maximum=2147483647, Minimum=-2147483648, TreeAccess=False)
division = GetInteger(Slider(5, range=0..20), AtLeast=1, AtMost=1, Maximum=2147483647, Minimum=-2147483648, TreeAccess=False)
opening_width = GetInteger(number_slider, AtLeast=1, AtMost=1, Maximum=2147483647, Minimum=-2147483648, Prompt="Opening Width", TreeAccess=False)

# ----
# Shell
yz_plane = YZPlane(Origin=Point(0, 0, 0))
number_slider_2 = Slider(1, range=0..2)
number_slider_3 = Slider(2, range=0..2)
sphere = Sphere(Base=yz_plane, Radius=shell_radius)
divide_domain² = DivideDomain²(Domain=sphere, UCount=number_slider_3, VCount=number_slider_2)
isotrim = Isotrim(Surface=sphere, Domain=divide_domain²)
xy_plane = XYPlane(Origin=Point(0, 0, 0))
list_item = ListItem(List=isotrim, Index=0, Wrap=True)
scale_nu = ScaleNU(Geometry=list_item, Plane=xy_plane, ScaleX=gene_pool, ScaleY=gene_pool, ScaleZ=1)  # -> graft(Geometry), Transform

circle = Circle(Plane=PlaneXY(0, 0, 0), Radius=shell_radius)
area = Area(Geometry=circle)  # -> Area, Centroid
scale = Scale(Geometry=circle, Center=area.Centroid, Factor=gene_pool)  # -> Geometry, Transform
division_2 = Division(A="360", B=division)
list_length = ListLength(List=scale.Geometry)
division_3 = Division(A=division_2, B=list_length)
addition = Addition(A=opening_width, B=division_3)
series = Series(Start=0, Step=addition, Count=list_length)
rotate = Rotate(Geometry=scale.Geometry, Angle=degrees(series), Plane=PlaneXY(0, 0, 0))  # -> Geometry, Transform
divide_curve = DivideCurve(Curve=rotate.Geometry, Count=division, Kinks=False)  # -> Points, Tangents, Parameters
line = Line(StartPoint=area.Centroid, EndPoint=divide_curve.Points)

divide_domain²_2 = DivideDomain²(Domain=sphere, UCount=number_slider_3, VCount=number_slider_2)
divide_domain²_3 = DivideDomain²(Domain=sphere, UCount=number_slider_3, VCount=number_slider_2)
scale_nu_2 = ScaleNU(Geometry=list_item, Plane=xy_plane, ScaleX=gene_pool, ScaleY=gene_pool, ScaleZ=1)  # -> graft(Geometry), Transform
scale_nu_3 = ScaleNU(Geometry=list_item, Plane=xy_plane, ScaleX=gene_pool, ScaleY=gene_pool, ScaleZ=1)  # -> graft(Geometry), Transform

maelstrom = Maelstrom(
    Geometry=line,
    Plane=xy_plane,
    First=Slider(2, range=0..20),
    Second=Slider(19, range=0..20),
    Angle=1.570796327,
    Rigid=False)
project = Project(Curve=maelstrom, Brep=scale_nu.Geometry, Direction=Vector(0, 0, 1))  # -> flatten(Curve)

partition_list = PartitionList(List=project, Size=division)
flip_matrix = FlipMatrix(Data=partition_list)
relative_item = RelativeItem(Tree=simplify(flip_matrix), Offset="{1}", WrapPaths=Toggle(True), WrapItems=False)  # -> ItemA, ItemB
panel = Panel(flip_matrix)
list_item_2 = ListItem(List=relative_item.ItemB, Index=0, Wrap=True)
list_item_3 = ListItem(List=relative_item.ItemA, Index=Slider(2, range=0..2), Wrap=True)
loft = Loft(Curves=flip_matrix, Options={Adjust=False, Closed=False, LoftEnds=0, LoftSimp=0, LoftType=0, Rebuild=10, Refit=0.01})
loft_2 = Loft(
    Curves=[list_item_3, list_item_2],
    Options={Adjust=False, Closed=False, LoftEnds=0, LoftSimp=0, LoftType=0, Rebuild=10, Refit=0.01})

mesh_colours = MeshColours(Mesh=loft_2, Colours=ColourSwatch(SwatchColor=RGBA(59, 219, 177, 110)))
mesh_colours_2 = MeshColours(Mesh=loft, Colours=ColourSwatch(SwatchColor=RGB(255, 255, 255)))

# ---- group: RH_OUT:Shell
geometry = Geometry(mesh_colours_2)

# ---- group: RH_OUT:GlassFacade
geometry_2 = Geometry(mesh_colours)
